# Grasshopper definition ghWebUI 0.2_testgh.gh (Grasshopper 1.0.8)
# plug-ins: RhinoCodePluginGH, ghWebUI.Components

# ----
# custom CSS
# .stepper-container {
#     margin: 15px 0;
#     font-family: 'Roboto', sans-serif;
# }
# .stepper-container label {
#     display: block;
#     margin-bottom: 8px;
#     color: #424242;
#     font-size: 14px;
#     font-weight: 500;
# }
# .stepper-controls {
#     display: flex;
#     align-items: center;
#     gap: 8px;
#     background: #f5f5f5;
#     padding: 4px;
#     border-radius: 4px;
# }
# .stepper-button {
#     width: 32px;
#     height: 32px;
#     border: none;
#     background: #2196F3;
#     color: white;
#     cursor: pointer;
#     border-radius: 50%;
#     font-size: 18px;
#     transition: background 0.3s, transform 0.2s;
#     display: flex;
#     align-items: center;
#     justify-content: center;
# }
# .stepper-button:hover {
#     background: #1976D2;
#     transform: scale(1.05);
# }
# .stepper-value {
#     width: 70px;
#     text-align: center;
#     padding: 8px;
#     border: none;
#     background: transparent;
#     font-size: 16px;
#     color: #212121;
#     font-weight: 500;
# }
# .stepper-value:focus {
#     outline: none;
# }
# .stepper-container {
#     margin: 12px 0;
#     font-family: 'Inter', sans-serif;
#     background: #1a1a1a;
#     padding: 15px;
#     border-radius: 8px;
# }
# .stepper-container label {
#     display: block;
#     margin-bottom: 10px;
#     color: #ffffff;
#     font-size: 14px;
#     letter-spacing: 0.5px;
# }
# .stepper-controls {
#     display: flex;
#     align-items: center;
#     gap: 10px;
#     background: #2d2d2d;
#     padding: 8px;
#     border-radius: 6px;
# }
# .stepper-button {
#     width: 30px;
#     height: 30px;
#     border: 2px solid #00ff88;
#     background: transparent;
#     color: #00ff88;
#     cursor: pointer;
#     border-radius: 4px;
#     font-size: 16px;
#     transition: all 0.3s;
#     display: flex;
#     align-items: center;
#     justify-content: center;
# }
# .stepper-button:hover {
#     background: #00ff88;
#     color: #1a1a1a;
#     box-shadow: 0 0 15px rgba(0, 255, 136, 0.5);
# }
# .stepper-value {
#     width: 80px;
#     text-align: center;
#     padding: 6px;
#     border: none;
#     background: #1a1a1a;
#     color: #ffffff;
#     font-size: 16px;
#     border-radius: 4px;
# }
# .stepper-value:focus {
#     outline: 2px solid #00ff88;
# }
# custom CSS
# .range-container {
#     margin: 12px 0;
#     font-family: 'Arial', sans-serif;
#     background: #2c2c2c;
#     padding: 15px;
#     border-radius: 8px;
# }
# .range-container label {
#     display: block;
#     margin-bottom: 8px;
#     color: #ffffff;
#     font-size: 14px;
# }
# .range-slider {
#     position: relative;
#     width: 100%;
#     height: 35px;
# }
# .range-slider input[type="range"] {
#     position: absolute;
#     width: 100%;
#     pointer-events: none;
#     -webkit-appearance: none;
#     z-index: 2;
#     height: 4px;
#     margin: 0;
#     background: none;
#     top: 50%;
#     transform: translateY(-50%);
# }
# .range-slider input[type="range"]::-webkit-slider-thumb {
#     pointer-events: all;
#     width: 16px;
#     height: 16px;
#     border-radius: 50%;
#     -webkit-appearance: none;
#     background: #00ff88;
#     cursor: pointer;
#     border: none;
#     box-shadow: 0 0 8px rgba(0,255,136,0.5);
# }
# .range-slider input[type="range"]::-moz-range-thumb {
#     pointer-events: all;
#     width: 16px;
#     height: 16px;
#     border-radius: 50%;
#     background: #00ff88;
#     cursor: pointer;
#     border: none;
#     box-shadow: 0 0 8px rgba(0,255,136,0.5);
# }
# .range-track {
#     position: absolute;
#     width: 100%;
#     height: 4px;
#     background: #4a4a4a;
#     border-radius: 2px;
#     z-index: 1;
#     top: 50%;
#     transform: translateY(-50%);
# }
panel = Panel(""".range-container {
    margin: 20px 0;
    font-family: 'Helvetica Neue', sans-serif;
}
.range-container label {
    display: block;
    margin-bottom: 10px;
    color: #333;
    font-size: 13px;
    font-weight: 500;
}
.range-slider {
    position: relative;
    width: 100%;
    height: 25px;
}
.range-slider input[type="range"] {
    position: absolute;
    width: 100%;
    pointer-events: none;
    -webkit-appearance: none;
    z-index: 2;
    height: 2px;
    margin: 0;
    background: none;
    top: 50%;
    transform: translateY(-50%);
}
.range-slider input[type="range"]::-webkit-slider-thumb {
    pointer-events: all;
    width: 12px;
    height: 12px;
    border-radius: 2px;
    -webkit-appearance: none;
    background: #ff4757;
    cursor: pointer;
    border: none;
    transition: transform 0.2s;
}
.range-slider input[type="range"]::-webkit-slider-thumb:hover {
    transform: scale(1.2);
}
.range-slider input[type="range"]::-moz-range-thumb {
    pointer-events: all;
    width: 12px;
    height: 12px;
    border-radius: 2px;
    background: #ff4757;
    cursor: pointer;
    border: none;
    transition: transform 0.2s;
}
.range-slider input[type="range"]::-moz-range-thumb:hover {
    transform: scale(1.2);
}
.range-track {
    position: absolute;
    width: 100%;
    height: 2px;
    background: #f1f1f1;
    z-index: 1;
    top: 50%;
    transform: translateY(-50%);
}""")

panel_2 = Panel("""Im a "Natural number" range slide
Im a "Real number" range slide""")
# input[type="number"] {
#     width: 140px;
#     height: 44px;
#     padding: 12px 16px;
# 
#     /* Stile Material */
#     border: none;
#     border-bottom: 2px solid #9e9e9e;
#     border-radius: 4px 4px 0 0;
# 
#     font-family: 'Google Sans', sans-serif;
#     font-size: 16px;
#     color: #212121;
# 
#     background-color: #f5f5f5;
#     transition: all 0.25s ease;
# }
# 
# input[type="number"]:hover {
#     background-color: #eeeeee;
# }
# 
# input[type="number"]:focus {
#     outline: none;
#     border-bottom: 2px solid #6200ee;
#     background-color: #f0f0f0;
#     box-shadow: 0 1px 0 0 #6200ee;
# }
# 
# /* Rimuove le frecce su/giù */
# input[type="number"]::-webkit-inner-spin-button,
# input[type="number"]::-webkit-outer-spin-button {
#     -webkit-appearance: none;
#     margin: 0;
# }
# input[type="number"] {
#     width: 130px;
#     height: 42px;
#     padding: 8px 15px;
# 
#     /* Bordi sottili e angoli smussati */
#     border: 1px solid #e0e0e0;
#     border-radius: 8px;
# 
#     font-family: 'Roboto', sans-serif;
#     font-size: 15px;
#     color: #2c3e50;
# 
#     background-color: #ffffff;
#     box-shadow: 0 2px 4px rgba(0,0,0,0.05);
#     transition: all 0.3s ease;
# }
# 
# input[type="number"]:hover {
#     border-color: #bdc3c7;
#     box-shadow: 0 3px 6px rgba(0,0,0,0.08);
# }
# 
# input[type="number"]:focus {
#     outline: none;
#     border-color: #3498db;
#     box-shadow: 0 0 0 3px rgba(52,152,219,0.15);
# }
panel_3 = Panel("""Im a "Natural number" stepper
Im a "Real number" stepper""")
# custom CSS
# .slider-container {
#             margin: 15px 0;
#             padding: 10px;
#             background: #f8f9fa;
#             border-radius: 5px;
#         }
#         .slider-container label {
#             display: block;
#             color: #2c3e50;
#             font-size: 14px;
#             font-weight: bold;
#             margin-bottom: 8px;
#         }
#         .slider-container input[type="range"] {
#             width: 100%;
#             height: 4px;
#             background: #e9ecef;
#             border-radius: 2px;
#             outline: none;
#             -webkit-appearance: none;
#         }
#         .slider-container input[type="range"]::-webkit-slider-thumb {
#             -webkit-appearance: none;
#             width: 18px;
#             height: 18px;
#             background: #3498db;
#             border-radius: 50%;
#             cursor: pointer;
#             border: 2px solid #fff;
#             box-shadow: 0 0 5px rgba(0,0,0,0.2);
#         }
# .slider-container {
#     margin: 15px 0;
#     padding: 20px;
#     background: #1a1a1a;
#     border: 1px solid #333;
# }
# .slider-container label {
#     color: #fff;
#     font-size: 14px;
#     text-shadow: 0 0 5px #0ff;
# }
# .slider-container input[type="range"] {
#     width: 100%;
#     height: 3px;
#     background: #333;
#     -webkit-appearance: none;
# }
# .slider-container input[type="range"]::-webkit-slider-thumb {
#     -webkit-appearance: none;
#     width: 20px;
#     height: 20px;
#     background: #0ff;
#     border-radius: 50%;
#     cursor: pointer;
#     box-shadow: 0 0 15px #0ff;
# }
# .slider-container {
#     margin: 20px 0;
#     padding: 15px;
#     background: #ffffff;
#     box-shadow: 0 2px 10px rgba(0,0,0,0.05);
# }
# .slider-container label {
#     color: #333;
#     font-size: 13px;
#     text-transform: uppercase;
#     letter-spacing: 1px;
# }
# .slider-container input[type="range"] {
#     width: 100%;
#     height: 2px;
#     background: #eee;
#     -webkit-appearance: none;
# }
# .slider-container input[type="range"]::-webkit-slider-thumb {
#     -webkit-appearance: none;
#     width: 12px;
#     height: 12px;
#     background: #000;
#     border-radius: 50%;
#     cursor: pointer;
# }
# 3. **Stile Material Design**:
# ```css
# .slider-container {
#     margin: 20px 0;
#     padding: 16px;
#     background: #fafafa;
#     border-radius: 8px;
# }
# .slider-container label {
#     color: #424242;
#     font-size: 14px;
#     font-weight: 500;
#     margin-bottom: 12px;
# }
# .slider-container input[type="range"] {
#     width: 100%;
#     height: 6px;
#     background: #e0e0e0;
#     border-radius: 3px;
#     -webkit-appearance: none;
# }
# .slider-container input[type="range"]::-webkit-slider-thumb {
#     -webkit-appearance: none;
#     width: 20px;
#     height: 20px;
#     background: #6200ee;
#     border-radius: 50%;
#     cursor: pointer;
#     transition: transform 0.2s;
# }
# .slider-container input[type="range"]::-webkit-slider-thumb:hover {
#     transform: scale(1.2);
# }
# ```
# 4. **Stile Neumorphism**:
# ```css
# .slider-container {
#     margin: 20px 0;
#     padding: 20px;
#     background: #e0e5ec;
#     border-radius: 15px;
#     box-shadow: 8px 8px 15px #a3b1c6,
#                 -8px -8px 15px #ffffff;
# }
# .slider-container label {
#     color: #6d7f97;
#     font-size: 14px;
#     font-weight: 600;
# }
# .slider-container input[type="range"] {
#     width: 100%;
#     height: 6px;
#     background: #e0e5ec;
#     border-radius: 3px;
#     -webkit-appearance: none;
#     box-shadow: inset 3px 3px 6px #a3b1c6,
#                 inset -3px -3px 6px #ffffff;
# }
# .slider-container input[type="range"]::-webkit-slider-thumb {
#     -webkit-appearance: none;
#     width: 22px;
#     height: 22px;
#     background: #e0e5ec;
#     border-radius: 50%;
#     cursor: pointer;
#     box-shadow: 5px 5px 10px #a3b1c6,
#                 -5px -5px 10px #ffffff;
# }
# ```
# .slider-container {
#     margin: 20px;
#     padding: 25px;
#     background: #000;
#     border: 2px solid #00ff88;
#     border-radius: 20px;
#     position: relative;
#     overflow: hidden;
# }
# 
# .slider-container::before {
#     content: '';
#     position: absolute;
#     top: 0;
#     left: 0;
#     width: 100%;
#     height: 100%;
#     background: linear-gradient(45deg,
#         transparent 0%,
#         rgba(0,255,136,0.1) 50%,
#         transparent 100%);
#     animation: shine 3s infinite linear;
# }
# 
# @keyframes shine {
#     0% { transform: translateX(-100%); }
#     100% { transform: translateX(100%); }
# }
# 
# .slider-container label {
#     color: #00ff88;
#     font-family: 'Courier New', monospace;
#     font-size: 16px;
#     text-transform: uppercase;
#     display: flex;
#     justify-content: space-between;
#     align-items: center;
#     margin-bottom: 20px;
# }
# 
# .slider-container .display {
#     background: #000;
#     border: 1px solid #00ff88;
#     padding: 5px 10px;
#     font-family: 'Digital', monospace;
#     color: #00ff88;
#     min-width: 60px;
#     text-align: right;
# }
# 
# .slider-container input[type="range"] {
#     width: 100%;
#     height: 8px;
#     background: #001a09;
#     border: 1px solid #00ff88;
#     border-radius: 4px;
#     -webkit-appearance: none;
# }
# 
# .slider-container input[type="range"]::-webkit-slider-thumb {
#     -webkit-appearance: none;
#     width: 20px;
#     height: 30px;
#     background: #000;
#     border: 2px solid #00ff88;
#     cursor: pointer;
#     position: relative;
#     border-radius: 4px;
# }
# 
# .slider-container input[type="range"]::-webkit-slider-thumb::before {
#     content: '';
#     position: absolute;
#     width: 2px;
#     height: 40px;
#     background: #00ff88;
#     top: -5px;
#     left: 50%;
#     transform: translateX(-50%);
# }
# 
# .slider-container input[type="range"]:focus {
#     outline: none;
#     box-shadow: 0 0 20px rgba(0,255,136,0.3);
# }
# 
# /* Indicatori di valore */
# .slider-container .value-indicators {
#     display: flex;
#     justify-content: space-between;
#     margin-top: 10px;
#     padding: 0 10px;
#     color: #00ff88;
#     font-size: 12px;
#     font-family: 'Courier New', monospace;
# }
# 
# /* Effetto hover sul container */
# .slider-container:hover {
#     box-shadow: 0 0 30px rgba(0,255,136,0.2);
#     transform: translateY(-2px);
#     transition: all 0.3s ease;
# }
# .slider-container {
#     margin: 30px 0;
#     padding: 25px;
#     background: #2c3e50;
#     border-radius: 15px;
#     position: relative;
# }
# 
# .slider-container label {
#     color: #ecf0f1;
#     font-size: 16px;
#     margin-bottom: 20px;
#     display: block;
# }
# 
# .slider-container .ticks {
#     display: flex;
#     justify-content: space-between;
#     padding: 0 10px;
#     margin-bottom: 5px;
# }
# 
# .slider-container .ticks span {
#     color: #bdc3c7;
#     font-size: 12px;
#     position: relative;
# }
# 
# .slider-container .ticks span::before {
#     content: '|';
#     position: absolute;
#     top: 20px;
#     left: 50%;
#     transform: translateX(-50%);
#     color: #7f8c8d;
# }
# 
# .slider-container input[type="range"] {
#     width: 100%;
#     height: 6px;
#     background: #34495e;
#     border-radius: 3px;
#     -webkit-appearance: none;
#     margin-top: 30px;
# }
# 
# .slider-container input[type="range"]::-webkit-slider-thumb {
#     -webkit-appearance: none;
#     width: 30px;
#     height: 30px;
#     background: #e74c3c;
#     border-radius: 15px;
#     cursor: pointer;
#     border: 3px solid #c0392b;
#     position: relative;
#     transition: all 0.3s ease;
# }
# 
# .slider-container input[type="range"]::-webkit-slider-thumb::after {
#     content: attr(value);
#     position: absolute;
#     top: -30px;
#     left: 50%;
#     transform: translateX(-50%);
#     color: white;
# }
# 
# .slider-container input[type="range"]::-webkit-slider-runnable-track {
#     height: 6px;
#     background: repeating-linear-gradient(
#         90deg,
#         #34495e,
#         #34495e 9%,
#         #7f8c8d 10%
#     );
# }
panel_4 = Panel("""Im a "Natural number" slider
Im a "Real number" slider""")
# custom CSS
# /* Variante moderna */
# input[type="number"] {
#     /* Dimensioni e padding */
#     width: 120px;
#     height: 40px;
#     padding: 8px 12px;
# 
#     /* Bordi e forma */
#     border: 1px solid #dfe1e5;
#     border-radius: 24px;
# 
#     /* Carattere */
#     font-family: 'Inter', sans-serif;
#     font-size: 16px;
#     color: #3c4043;
# 
#     /* Ombreggiatura e sfondo */
#     background-color: #fff;
#     box-shadow: 0 1px 3px rgba(0,0,0,0.1);
# 
#     /* Transizioni */
#     transition: all 0.2s cubic-bezier(0.4, 0, 0.2, 1);
# }
# 
# input[type="number"]:hover {
#     box-shadow: 0 2px 6px rgba(0,0,0,0.15);
# }
# 
# input[type="number"]:focus {
#     outline: none;
#     border-color: #1a73e8;
#     box-shadow: 0 1px 2px rgba(26,115,232,0.3);
# }
# input[type="number"] {
#     width: 125px;
#     height: 45px;
#     padding: 10px 15px;
# 
#     /* Effetto neumorphic */
#     border: none;
#     border-radius: 15px;
#     background: #f0f2f5;
#     box-shadow: 5px 5px 10px #d1d9e6,
#                 -5px -5px 10px #ffffff;
# 
#     font-family: 'SF Pro Display', sans-serif;
#     font-size: 16px;
#     color: #34495e;
# 
#     transition: all 0.4s cubic-bezier(0.23, 1, 0.32, 1);
# }
# 
# input[type="number"]:hover {
#     box-shadow: 3px 3px 6px #d1d9e6,
#                 -3px -3px 6px #ffffff;
# }
# 
# input[type="number"]:focus {
#     outline: none;
#     box-shadow: inset 2px 2px 5px #d1d9e6,
#                 inset -2px -2px 5px #ffffff;
# }
# /* Stile base per tutti gli input numerici */
# input[type="number"] {
#     /* Dimensioni e padding */
#     width: 120px;
#     height: 40px;
#     padding: 8px 12px;
# 
#     /* Bordi e forma */
#     border: 2px solid #e0e0e0;
#     border-radius: 8px;
# 
#     /* Carattere */
#     font-family: -apple-system, BlinkMacSystemFont, 'Segoe UI', Roboto, sans-serif;
#     font-size: 16px;
#     color: #333;
# 
#     /* Transizioni fluide */
#     transition: all 0.3s ease;
# }
# 
# /* Stato hover */
# input[type="number"]:hover {
#     border-color: #999;
#     box-shadow: 0 2px 4px rgba(0,0,0,0.1);
# }
# 
# /* Stato focus */
# input[type="number"]:focus {
#     outline: none;
#     border-color: #2196F3;
#     box-shadow: 0 2px 8px rgba(33,150,243,0.2);
# }
# 
# /* Rimuove le frecce su/giù di default */
# input[type="number"]::-webkit-inner-spin-button,
# input[type="number"]::-webkit-outer-spin-button {
#     -webkit-appearance: none;
#     margin: 0;
# }
# 
# /* Per Firefox */
# input[type="number"] {
#     -moz-appearance: textfield;
# }
panel_5 = Panel("""Im a "Natural number"
Im a "Real number"
""")
panel_6 = Panel("""stepper1
stepper2""")
panel_7 = Panel("""slider1
slider2""")
panel_8 = Panel("""range1
range2""")
panel_9 = Panel("""number1
number2""")
panel_10 = Panel("""1
3""")
panel_11 = Panel("""1
0.5""")
panel_12 = Panel("""1
0.5""")
panel_13 = Panel("""1
3""")
panel_14 = Panel("""1
0.5""")
panel_15 = Panel("""1
3""")
panel_16 = Panel("""1
3""")
panel_17 = Panel("""1
0.5""")
# range slider control
range_slider_control = Python3Script(
    label=graft(panel_2),
    step=graft(panel_12),
    min_val=graft(panel_13),
    max_val=graft("10"),
    default_min=graft("5"),
    default_max=graft("8"),
    control_id=graft(panel_8),
    custom_css=panel)  # -> out, flatten(range_html); inputs label: String
# ---------- range_slider_control: Python ----------
"""Componente per generare uno slider con due maniglie per range"""

def create_range_slider(label, min_val=0, max_val=100, default_min=25, default_max=75, step=1, control_id="range1", custom_css=""):
    # CSS di default
    default_css = """
        .range-container {
            margin: 10px 0;
        }
        .range-container label {
            display: block;
            margin-bottom: 5px;
        }
        .range-slider {
            position: relative;
            width: 100%;
            height: 30px;
        }
        .range-slider input[type="range"] {
            position: absolute;
            width: 100%;
            pointer-events: none;
            -webkit-appearance: none;
            z-index: 2;
            height: 4px;
            margin: 0;
            background: none;
            top: 50%;
            transform: translateY(-50%);
        }
        .range-slider input[type="range"]::-webkit-slider-thumb {
            pointer-events: all;
            width: 12px;
            height: 12px;
            border-radius: 2px;
            -webkit-appearance: none;
            background: #666;
            cursor: pointer;
            border: none;
        }
        .range-slider input[type="range"]::-moz-range-thumb {
            pointer-events: all;
            width: 12px;
            height: 12px;
            border-radius: 2px;
            background: #666;
            cursor: pointer;
            border: none;
        }
        .range-track {
            position: absolute;
            width: 100%;
            height: 4px;
            background: #ddd;
            z-index: 1;
            top: 50%;
            transform: translateY(-50%);
        }
    """
    
    css_content = default_css
    if custom_css and custom_css.strip():
        css_content = custom_css.strip()
    
    html = f"""
    <style>
        {css_content}
    </style>
    <div class="control range-container" id="{control_id}-container">
        <label>{label}: 
            <span id="{control_id}-min-value">{default_min}</span> - 
            <span id="{control_id}-max-value">{default_max}</span>
        </label>
        <div class="range-slider">
            <div class="range-track"></div>
            <input type="range" 
                   id="{control_id}-min" 
                   min="{min_val}" 
                   max="{max_val}" 
                   value="{default_min}"
                   step="{step}"
                   oninput="updateRangeValue_{control_id}()">
            <input type="range" 
                   id="{control_id}-max" 
                   min="{min_val}" 
                   max="{max_val}" 
                   value="{default_max}"
                   step="{step}"
                   oninput="updateRangeValue_{control_id}()">
        </div>
    </div>
    <script>
        function formatNumber_{control_id}(value) {{
            // Determina il numero di decimali basato sullo step
            const step = {step};
            if (Number.isInteger(step)) {{
                return Math.round(value).toString();
            }} else {{
                const decimals = step.toString().split('.')[1]?.length || 0;
                return value.toFixed(decimals);
            }}
        }}

        function updateRangeValue_{control_id}() {{
            const minSlider = document.getElementById('{control_id}-min');
            const maxSlider = document.getElementById('{control_id}-max');
            const minDisplay = document.getElementById('{control_id}-min-value');
            const maxDisplay = document.getElementById('{control_id}-max-value');
            
            let minVal = parseFloat(minSlider.value);
            let maxVal = parseFloat(maxSlider.value);
            
            // Assicurati che min non superi max
            if (minVal > maxVal) {{
                if (this === minSlider) {{
                    minVal = maxVal;
                    minSlider.value = minVal;
                }} else {{
                    maxVal = minVal;
                    maxSlider.value = maxVal;
                }}
            }}
            
            // Formatta i valori individuali per il display
            const formattedMin = formatNumber_{control_id}(minVal);
            const formattedMax = formatNumber_{control_id}(maxVal);
            
            minDisplay.textContent = formattedMin;
            maxDisplay.textContent = formattedMax;
            
            // Salva i valori nel localStorage
            localStorage.setItem('{control_id}_min', minVal);
            localStorage.setItem('{control_id}_max', maxVal);
            
            // Crea la stringa combinata nel formato richiesto
            const combinedValue = `${{formattedMin}} To ${{formattedMax}}`;
            
            const data = {{
                controls: {{
                    '{control_id}_value': combinedValue
                }}
            }};
            updateServer(data);
        }}
        
        document.addEventListener('controlsInitialized', function() {{
            const minSlider = document.getElementById('{control_id}-min');
            const maxSlider = document.getElementById('{control_id}-max');
            if (minSlider && maxSlider) {{
                // Recupera i valori salvati
                const savedMin = localStorage.getItem('{control_id}_min');
                const savedMax = localStorage.getItem('{control_id}_max');
                if (savedMin !== null) {{
                    minSlider.value = savedMin;
                }}
                if (savedMax !== null) {{
                    maxSlider.value = savedMax;
                }}
                updateRangeValue_{control_id}();
            }}
        }});
    </script>
    """
    return html

# Output: HTML dello slider range
range_html = create_range_slider(label, min_val, max_val, default_min, default_max, step, control_id, custom_css)
# ---------- end range_slider_control ----------
# stepper control
stepper_control = Python3Script(
    label=graft(panel_3),
    step=graft(panel_11),
    min_val=graft(panel_10),
    max_val=graft("10"),
    default_val=graft(panel_10),
    control_id=graft(panel_6))  # -> out, flatten(stepper_html); inputs label: String
# ---------- stepper_control: Python ----------
"""Componente per generare un controllo stepper"""

def create_stepper(label, min_val=0, max_val=100, default_val=50, step=1, control_id="stepper1", custom_css=""):
    # CSS di default
    default_css = """
        .stepper-container {
            margin: 10px 0;
        }
        .stepper-container label {
            display: block;
            margin-bottom: 5px;
        }
        .stepper-controls {
            display: flex;
            align-items: center;
            gap: 5px;
        }
        .stepper-button {
            width: 24px;
            height: 24px;
            border: 1px solid #ccc;
            background: #ffffff;
            cursor: pointer;
            border-radius: 2px;
            font-size: 14px;
        }
        .stepper-button:hover {
            background: #e8e8e8;
        }
        .stepper-value {
            width: 60px;
            text-align: center;
            padding: 2px 5px;
            border: 1px solid #ccc;
            border-radius: 2px;
        }
    """
    
    css_content = default_css
    if custom_css and custom_css.strip():
        css_content = custom_css.strip()
    
    html = f"""
    <style>
        {css_content}
    </style>
    <div class="control stepper-container" id="{control_id}-container">
        <label for="{control_id}">{label}</label>
        <div class="stepper-controls">
            <button class="stepper-button" onclick="updateStepperValue_{control_id}(-{step})">-</button>
            <input type="number" 
                   id="{control_id}" 
                   class="stepper-value"
                   min="{min_val}" 
                   max="{max_val}" 
                   value="{default_val}"
                   step="{step}"
                   oninput="validateStepperValue_{control_id}(this.value)">
            <button class="stepper-button" onclick="updateStepperValue_{control_id}({step})">+</button>
        </div>
    </div>
    <script>
        function validateStepperValue_{control_id}(value) {{
            let numValue = parseFloat(value);
            if (numValue < {min_val}) numValue = {min_val};
            if (numValue > {max_val}) numValue = {max_val};
            
            document.getElementById('{control_id}').value = numValue;
            
            const data = {{
                controls: {{
                    '{control_id}_value': numValue
                }}
            }};
            updateServer(data);
        }}
        
        function updateStepperValue_{control_id}(increment) {{
            const input = document.getElementById('{control_id}');
            const newValue = parseFloat(input.value) + increment;
            validateStepperValue_{control_id}(newValue);
        }}
        
        document.addEventListener('controlsInitialized', function() {{
            const input = document.getElementById('{control_id}');
            if (input) {{
                validateStepperValue_{control_id}(input.value);
            }}
        }});
    </script>
    """
    return html

# Output: HTML dello stepper
stepper_html = create_stepper(label, min_val, max_val, default_val, step, control_id, custom_css)
# ---------- end stepper_control ----------
# number control
number_control = Python3Script(
    label=graft(panel_5),
    step=graft(panel_17),
    min_val=graft(panel_16),
    max_val=graft("10"),
    default_val=graft(panel_16),
    control_id=graft(panel_9))  # -> out, flatten(number_html); inputs label: String
# ---------- number_control: Python ----------
"""Componente per generare un input numerico con spinbutton"""

def create_number_input(label, min_val=0, max_val=100, default_val=50, step=1, control_id="number1", custom_css=""):
    # CSS di default
    default_css = """
        .number-container {
            margin: 10px 0;
        }
        .number-container label {
            display: block;
            margin-bottom: 5px;
        }
        .number-container input[type="number"] {
            width: 80px;
            padding: 2px 5px;
            border: 1px solid #ccc;
            border-radius: 2px;
        }
        .number-container input[type="number"]:focus {
            outline: none;
            border-color: #666;
        }
    """
    
    css_content = default_css
    if custom_css and custom_css.strip():
        css_content = custom_css.strip()
    
    html = f"""
    <style>
        {css_content}
    </style>
    <div class="control number-container" id="{control_id}-container">
        <label for="{control_id}">{label}</label>
        <input type="number" 
               id="{control_id}" 
               min="{min_val}" 
               max="{max_val}" 
               value="{default_val}"
               step="{step}"
               oninput="updateNumberValue_{control_id}(this)">
    </div>
    <script>
        function updateNumberValue_{control_id}(input) {{
            let value = parseFloat(input.value);
            
            // Validazione dei limiti
            if (value < {min_val}) value = {min_val};
            if (value > {max_val}) value = {max_val};
            
            const data = {{
                controls: {{
                    '{control_id}_value': value
                }}
            }};
            updateServer(data);
        }}
        
        // Inizializzazione
        document.addEventListener('controlsInitialized', function() {{
            const input = document.getElementById('{control_id}');
            if (input) {{
                const value = input.value;
                // Non chiamare updateNumberValue qui per evitare loop
            }}
        }});
    </script>
    """
    return html

# Output: HTML dell'input numerico
number_html = create_number_input(label, min_val, max_val, default_val, step, control_id, custom_css)
# ---------- end number_control ----------
# slider control
slider_control = Python3Script(label=panel_4, step=panel_14, min_val=panel_15, max_val="10", default_val=panel_14, control_id=panel_7)  # -> out, flatten(slider_html); inputs label: String
# ---------- slider_control: Python ----------
"""Componente per generare uno slider"""

# Input:
#   label: etichetta dello slider (stringa)
#   min_val: valore minimo (numero)
#   max_val: valore massimo (numero)
#   default_val: valore predefinito (numero)
#   step: incremento dello slider (numero)
#   control_id: identificatore univoco dello slider (stringa)
#   custom_css: CSS personalizzato per lo slider (stringa, opzionale)

def create_slider(label, min_val=0, max_val=100, default_val=50, step=1, control_id="slider1", custom_css=""):
    # CSS di default per lo slider (minimo, solo layout base)
    default_css = """
        .slider-container {
            margin: 10px 0;
        }
        .slider-container label {
            display: block;
            margin-bottom: 5px;
        }
        .slider-container input[type="range"] {
            width: 100%;
            -webkit-appearance: none;
            height: 4px;
            background: #ddd;
            border-radius: 0;
            margin: 10px 0;
        }
        .slider-container input[type="range"]::-webkit-slider-thumb {
            -webkit-appearance: none;
            width: 12px;
            height: 12px;
            background: #666;
            border-radius: 2px;
            cursor: pointer;
            border: none;
        }
        .slider-container input[type="range"]::-moz-range-thumb {
            width: 12px;
            height: 12px;
            background: #666;
            border-radius: 2px;
            cursor: pointer;
            border: none;
        }
        .slider-container input[type="range"]:focus {
            outline: none;
        }
    """
    
    # Gestisci il CSS personalizzato
    css_content = default_css
    if custom_css and custom_css.strip():
        css_content = custom_css.strip()
    
    html = f"""
    <style>
        {css_content}
    </style>
    <div class="control slider-container" id="{control_id}-container">
        <label for="{control_id}">{label}: <span id="{control_id}-value">{default_val}</span></label>
        <input type="range" 
               id="{control_id}" 
               min="{min_val}" 
               max="{max_val}" 
               value="{default_val}"
               step="{step}"
               oninput="updateSliderValue_{control_id}(this)">
    </div>
    <script>
        function formatNumber_{control_id}(value) {{
            // Determina il numero di decimali basato sullo step
            const step = {step};
            if (Number.isInteger(step)) {{
                return Math.round(value).toString();
            }} else {{
                const decimals = step.toString().split('.')[1]?.length || 0;
                return value.toFixed(decimals);
            }}
        }}

        function updateSliderValue_{control_id}(slider) {{
            const value = parseFloat(slider.value);
            // Aggiorna il display del valore
            const displayElement = document.getElementById('{control_id}-value');
            if (displayElement) {{
                displayElement.textContent = formatNumber_{control_id}(value);
            }}
            
            const data = {{
                controls: {{
                    '{control_id}_value': value
                }}
            }};
            updateServer(data);
        }}
        
        // Registra un observer per questo slider specifico
        document.addEventListener('DOMContentLoaded', function() {{
            const slider = document.getElementById('{control_id}');
            if (slider) {{
                // Aggiorna il display del valore iniziale
                const displayElement = document.getElementById('{control_id}-value');
                if (displayElement) {{
                    const value = parseFloat(slider.value);
                    displayElement.textContent = formatNumber_{control_id}(value);
                }}
            }}
        }});

        // Gestisci l'inizializzazione dei valori salvati
        document.addEventListener('controlsInitialized', function() {{
            const slider = document.getElementById('{control_id}');
            if (slider) {{
                const value = parseFloat(slider.value);
                const displayElement = document.getElementById('{control_id}-value');
                if (displayElement) {{
                    displayElement.textContent = formatNumber_{control_id}(value);
                }}
                // Non chiamare updateSliderValue qui per evitare loop
            }}
        }});
    </script>
    """
    return html

# Output: HTML dello slider
slider_html = create_slider(label, min_val, max_val, default_val, step, control_id, custom_css)
# ---------- end slider_control ----------
server_setup = ServerSetup()  # -> Port, Server_instance
# html builder
merge = Merge(
    Data1=slider_control.slider_html,
    Data2=number_control.number_html,
    Data3=stepper_control.stepper_html,
    Data4=range_slider_control.range_html)
html_builder = Python3Script(controls_html=flatten(merge), include_3d_viewer=Toggle(True))  # -> out, page_html; inputs controls_html: list, include_3d_viewer: Boolean
# ---------- html_builder: Python ----------
"""Componente per costruire l'HTML della pagina web"""

# Input:
#   controls_html: lista di stringhe HTML per i controlli
#   include_3d_viewer: booleano per includere il visualizzatore 3D

def build_page_html(controls_html=[], include_3d_viewer=True):
    # Estrai tutti gli stili CSS dai controlli
    css_blocks = []
    html_blocks = []
    js_blocks = []
    
    for control in controls_html:
        # Estrai il CSS (tutto ciò che è tra <style> e </style>)
        css_start = control.find('<style>')
        css_end = control.find('</style>')
        if css_start != -1 and css_end != -1:
            css = control[css_start + 7:css_end].strip()
            if css not in css_blocks:  # Evita duplicati
                css_blocks.append(css)
        
        # Estrai l'HTML (tutto ciò che è tra </style> e <script>)
        html_start = control.find('</style>') + 8
        html_end = control.find('<script>')
        if html_start != -1 and html_end != -1:
            html = control[html_start:html_end].strip()
            html_blocks.append(html)
        
        # Estrai il JavaScript (tutto ciò che è tra <script> e </script>)
        js_start = control.find('<script>') + 8
        js_end = control.find('</script>')
        if js_start != -1 and js_end != -1:
            js = control[js_start:js_end].strip()
            js_blocks.append(js)
    
    # CSS base e dei controlli combinati
    base_css = """
        body { 
            font-family: Arial, sans-serif; 
            margin: 0;
            display: flex;
            flex-direction: column;
            height: 100vh;
        }
        #controls { 
            padding: 20px;
            background-color: #f5f5f5;
        }
        .control { 
            margin: 10px 0;
            padding: 15px;
            background-color: white;
            border-radius: 8px;
            box-shadow: 0 2px 4px rgba(0,0,0,0.1);
        }
        #viewer {
            flex-grow: 1;
            width: 100%;
        }
    """
    
    # Costruisci il CSS combinato
    combined_css = f"""
    <style>
        {base_css}
        {' '.join(css_blocks)}
    </style>
    """
    
    # Costruisci l'HTML dei controlli
    controls_section = f"""
    <div id="controls">
        {' '.join(html_blocks)}
    </div>
    """
    
    # Gestisci il viewer 3D
    viewer_html = """
    <div id="viewer"></div>
    <script src="https://cdnjs.cloudflare.com/ajax/libs/three.js/r128/three.min.js"></script>
    <script src="https://cdn.jsdelivr.net/npm/three@0.128.0/examples/js/controls/OrbitControls.js"></script>
    """ if include_3d_viewer else ""
    
    # Combina tutto il JavaScript
    combined_js = f"""
    <script>
        // Variabile globale per mantenere lo stato di tutti i controlli
        let globalControlsState = {{}};

        // Funzione per inizializzare i valori dei controlli
        async function initializeControls() {{
            try {{
                const response = await fetch('/get_initial_values');
                const data = await response.json();
                
                if (data.status === 'success') {{
                    const values = data.values;
                    // Aggiorna lo stato globale
                    globalControlsState = values;
                    
                    // Itera su tutti i controlli
                    Object.keys(values).forEach(key => {{
                        const value = values[key];
                        const controlId = key.replace('_value', '');
                        const element = document.getElementById(controlId);
                        const displayElement = document.getElementById(controlId + '-value');
                        
                        if (element) {{
                            // Imposta il valore in base al tipo di controllo
                            if (element.type === 'range' || element.type === 'number') {{
                                element.value = value;
                                // Aggiorna il display del valore
                                if (displayElement) {{
                                    displayElement.textContent = value;
                                }}
                            }} else if (element.tagName === 'SELECT') {{
                                element.value = value;
                            }} else if (element.type === 'checkbox') {{
                                element.checked = value === true || value === 'true';
                            }}
                        }}
                    }});

                    // Notifica che i controlli sono stati inizializzati
                    document.dispatchEvent(new CustomEvent('controlsInitialized'));
                }}
            }} catch (error) {{
                console.error('Errore nel caricamento dei valori iniziali:', error);
            }}
        }}

        // Funzione aggiornata per l'update del server
        function updateServer(data) {{
            // Aggiorna lo stato globale
            Object.assign(globalControlsState, data.controls);
            
            // Invia lo stato completo al server
            fetch('/update', {{
                method: 'POST',
                headers: {{
                    'Content-Type': 'application/json',
                }},
                body: JSON.stringify({{
                    controls: globalControlsState
                }})
            }});
        }}

        // Inizializza i controlli al caricamento della pagina
        document.addEventListener('DOMContentLoaded', initializeControls);
        
        // Codice dei controlli
        {' '.join(js_blocks)}
    </script>
    """
    
    # Costruisci la pagina completa
    html = f"""
    <!DOCTYPE html>
    <html>
    <head>
        <title>Grasshopper Interface</title>
        {combined_css}
    </head>
    <body>
        {controls_section}
        {viewer_html}
        {combined_js}
    </body>
    </html>
    """
    
    return html

# Output: HTML completo della pagina
page_html = build_page_html(controls_html, include_3d_viewer)
# ---------- end html_builder ----------
server_setup_2 = Python3Script()  # -> out, port, server_instance
# ---------- server_setup_2: Python ----------
from flask import Flask, render_template_string, jsonify, request
import threading
import socket
import time
import json
import os
import tempfile
import requests

# Input:
#   html_content: stringa contenente l'HTML della pagina (da html_builder.py)
#   restart: bool - Se True, riavvia il server (opzionale)

# Usa la directory temporanea del sistema
JSON_PATH = os.path.join(tempfile.gettempdir(), 'gh_interface_data.json')
INSTANCE_PATH = os.path.join(tempfile.gettempdir(), 'gh_server_instance.json')
HTML_CACHE_PATH = os.path.join(tempfile.gettempdir(), 'gh_html_cache.json')

def init_json_file():
    """Inizializza il file JSON se non esiste"""
    try:
        current_data = {"controls": {}, "last_update": time.time()}
        
        if os.path.exists(JSON_PATH):
            try:
                with open(JSON_PATH, 'r') as f:
                    content = f.read().strip()
                    if content:
                        data = json.loads(content)
                        if isinstance(data, dict):
                            current_data = data
            except:
                pass
        
        # Assicurati che la struttura sia corretta
        if 'controls' not in current_data:
            current_data['controls'] = {}
        if 'last_update' not in current_data:
            current_data['last_update'] = time.time()
            
        # Salva il file
        with open(JSON_PATH, 'w') as f:
            json.dump(current_data, f, indent=2)
            
        return current_data
    except Exception as e:
        print(f"Errore nell'inizializzazione del file JSON: {e}")
        return {"controls": {}, "last_update": time.time()}

def get_running_instance():
    """Recupera informazioni sull'istanza corrente del server"""
    try:
        if os.path.exists(INSTANCE_PATH):
            with open(INSTANCE_PATH, 'r') as f:
                data = json.load(f)
                # Verifica se il server è effettivamente in esecuzione
                try:
                    with socket.socket(socket.AF_INET, socket.SOCK_STREAM) as s:
                        s.settimeout(0.1)
                        result = s.connect_ex(('127.0.0.1', data['port']))
                        if result == 0:
                            return data
                except:
                    pass
    except:
        pass
    return None

def save_instance_info(port):
    """Salva le informazioni dell'istanza corrente"""
    try:
        with open(INSTANCE_PATH, 'w') as f:
            json.dump({'port': port, 'timestamp': time.time()}, f)
    except:
        pass

class WebInterface:
    _instance = None
    
    def __new__(cls):
        if cls._instance is None:
            cls._instance = super(WebInterface, cls).__new__(cls)
        return cls._instance
    
    def __init__(self):
        if not hasattr(self, 'initialized'):
            self.initialized = True
            self.app = Flask(__name__)
            self.server_thread = None
            
            # Controlla se esiste già un'istanza attiva
            running_instance = get_running_instance()
            if running_instance:
                self.port = running_instance['port']
                # Prova a fermare il server esistente
                try:
                    requests.get(f'http://127.0.0.1:{self.port}/shutdown', timeout=0.2)
                    time.sleep(0.5)
                except:
                    pass
            else:
                self.port = self.find_free_port()
            
            save_instance_info(self.port)
            self.setup_routes()
            init_json_file()
            self.check_server_status()

    def find_free_port(self):
        """Trova una porta libera"""
        for port in range(5000, 5500):
            try:
                with socket.socket(socket.AF_INET, socket.SOCK_STREAM) as s:
                    s.settimeout(0.1)
                    result = s.connect_ex(('127.0.0.1', port))
                    if result != 0:  # La porta è libera
                        return port
            except:
                continue
        
        # Se non troviamo una porta nel range, lasciamo che il sistema ne assegni una
        with socket.socket(socket.AF_INET, socket.SOCK_STREAM) as s:
            s.bind(('127.0.0.1', 0))
            return s.getsockname()[1]
            
    def setup_routes(self):
        @self.app.route('/')
        def index():
            try:
                # Legge l'HTML dal file cache
                if os.path.exists(HTML_CACHE_PATH):
                    with open(HTML_CACHE_PATH, 'r') as f:
                        data = json.load(f)
                        if data['port'] == self.port:  # Verifica che l'HTML sia per questa istanza
                            return render_template_string(data['html'])
            except Exception as e:
                print(f"Errore nel caricamento dell'HTML dalla cache: {e}")
            
            # Fallback all'HTML originale se c'è un errore
            return render_template_string(html_content)
        
        @self.app.route('/update', methods=['POST'])
        def update():
            try:
                new_data = request.json
                if not isinstance(new_data, dict):
                    return jsonify({"status": "error", "message": "Invalid data format"}), 400

                current_data = {"controls": {}, "last_update": time.time()}
                
                # Leggi i dati esistenti se il file esiste
                if os.path.exists(JSON_PATH):
                    try:
                        with open(JSON_PATH, 'r') as f:
                            content = f.read().strip()
                            if content:
                                current_data = json.loads(content)
                    except json.JSONDecodeError as e:
                        print(f"Errore nella lettura del JSON esistente: {e}")
                        # Continua con i dati di default se c'è un errore
                
                # Assicurati che la struttura sia corretta
                if not isinstance(current_data, dict):
                    current_data = {"controls": {}, "last_update": time.time()}
                if 'controls' not in current_data:
                    current_data['controls'] = {}
                    
                # Aggiorna i controlli
                if 'controls' in new_data:
                    current_data['controls'].update(new_data['controls'])
                current_data['last_update'] = time.time()
                
                # Salva i dati aggiornati
                with open(JSON_PATH, 'w') as f:
                    json.dump(current_data, f, indent=2)  # Usa indent per una formattazione leggibile
                    
                return jsonify({"status": "success"})
            except Exception as e:
                print(f"Errore nell'aggiornamento dei valori: {e}")
                return jsonify({"status": "error", "message": str(e)}), 500
        
        @self.app.route('/get_values')
        def get_values():
            try:
                with open(JSON_PATH, 'r') as f:
                    return jsonify(json.load(f))
            except Exception as e:
                return jsonify({"status": "error", "message": str(e)}), 500
        
        @self.app.route('/favicon.ico')
        def favicon():
            return '', 204  # Restituisce una risposta vuota con status code 204 (No Content)

        @self.app.route('/get_geometry')
        def get_geometry():
            try:
                geometry_path = os.path.join(tempfile.gettempdir(), 'gh_geometry_data.json')
                if os.path.exists(geometry_path):
                    with open(geometry_path, 'r') as f:
                        return jsonify(json.load(f))
                return jsonify({"status": "error", "message": "No geometry data"})
            except Exception as e:
                return jsonify({"status": "error", "message": str(e)})

        @self.app.route('/get_initial_values')
        def get_initial_values():
            try:
                if os.path.exists(JSON_PATH):
                    with open(JSON_PATH, 'r') as f:
                        content = f.read().strip()
                        if content:
                            data = json.loads(content)
                            if isinstance(data, dict) and 'controls' in data:
                                return jsonify({"status": "success", "values": data['controls']})
                return jsonify({"status": "success", "values": {}})
            except Exception as e:
                print(f"Errore nel recupero dei valori iniziali: {e}")
                return jsonify({"status": "error", "message": str(e)}), 500

        @self.app.route('/shutdown', methods=['GET'])
        def shutdown():
            func = request.environ.get('werkzeug.server.shutdown')
            if func is None:
                raise RuntimeError('Non in esecuzione con il server Werkzeug')
            func()
            return 'Server in chiusura...'

    def stop_server(self):
        """Ferma il server se è in esecuzione"""
        if self.server_thread and self.server_thread.is_alive():
            print("\nChiusura server in corso...")
            try:
                requests.get(f'http://127.0.0.1:{self.port}/shutdown', timeout=0.2)
            except:
                pass
            
            # Attendiamo che il thread termini
            self.server_thread.join(timeout=2)
            self.server_thread = None
            
            # Aspettiamo che la porta si liberi
            max_attempts = 20  # Aumentiamo il numero di tentativi
            for _ in range(max_attempts):
                try:
                    with socket.socket(socket.AF_INET, socket.SOCK_STREAM) as s:
                        s.settimeout(0.1)
                        result = s.connect_ex(('127.0.0.1', self.port))
                        if result != 0:  # La porta è libera
                            print(f"Server sulla porta {self.port} chiuso.")
                            return
                except:
                    pass
                time.sleep(0.3)  # Aumentiamo il tempo di attesa tra i tentativi
            
            # Se non riusciamo a liberare la porta, ne troviamo una nuova
            print(f"Impossibile liberare la porta {self.port}, cerco una nuova porta...")
            self.port = self.find_free_port()
            print(f"Nuova porta assegnata: {self.port}")

    def start_server(self):
        """Avvia il server su una porta libera"""
        self.stop_server()
        
        # Verifica ulteriore che la porta sia libera
        try:
            with socket.socket(socket.AF_INET, socket.SOCK_STREAM) as s:
                s.settimeout(0.1)
                result = s.connect_ex(('127.0.0.1', self.port))
                if result == 0:  # La porta è ancora in uso
                    self.port = self.find_free_port()
                    print(f"Porta occupata, usando la nuova porta: {self.port}")
        except:
            pass
        
        if not self.server_thread:
            self.server_thread = threading.Thread(target=self._run_server)
            self.server_thread.daemon = True
            self.server_thread.start()
            time.sleep(1)
            self.check_server_status()

    def _run_server(self):
        try:
            self.app.run(
                host='127.0.0.1',
                port=self.port, 
                debug=False,
                use_reloader=False
            )
        except Exception as e:
            print(f"Errore nell'avvio del server: {e}")

    def check_server_status(self):
        """Controlla e mostra lo stato del server"""
        active_ports = []
        for port in range(5000, 5020):
            try:
                with socket.socket(socket.AF_INET, socket.SOCK_STREAM) as s:
                    s.settimeout(0.1)
                    result = s.connect_ex(('127.0.0.1', port))
                    if result == 0:
                        active_ports.append(port)
            except:
                pass
        
        # Prepara il messaggio di stato
        status_msg = f"\n=== STATO SERVER ===\n"
        status_msg += f"Porta attuale: {self.port}\n"
        
        if len(active_ports) > 0:
            other_ports = [p for p in active_ports if p != self.port]
            if other_ports:
                status_msg += f"Altre istanze attive trovate sulle porte: {other_ports}\n"
        
        status_msg += "==================="
        print(status_msg)
        return status_msg

class ServerInstance:
    _instance = None
    _is_running = False
    
    @classmethod
    def get_instance(cls):
        if cls._instance is None:
            cls._instance = WebInterface()
        return cls._instance
    
    @classmethod
    def start_if_not_running(cls):
        instance = cls.get_instance()
        
        # Forza sempre la chiusura del server esistente
        instance.stop_server()
        cls._is_running = False
        
        # Avvia una nuova istanza
        instance.start_server()
        cls._is_running = True
        
        return instance.port

# Output: porta del server corrente
server_instance = ServerInstance.start_if_not_running()
port = server_instance  # Assegna la porta restituita alla variabile di output
# ---------- end server_setup_2 ----------
# variable monitor
value_monitor = Python3Script()  # -> monitor
# ---------- value_monitor: Python ----------
"""Componente per monitorare i valori dei controlli"""

import json
import os
import tempfile
import time

JSON_PATH = os.path.join(tempfile.gettempdir(), 'gh_interface_data.json')

class ValueMonitor:
    def __init__(self):
        self.json_path = os.path.join(tempfile.gettempdir(), 'gh_interface_data.json')
        self.last_read_time = 0
        self.cached_values = {}

    def read_values(self):
        """Legge i valori dal file JSON se sono stati aggiornati"""
        try:
            # Verifica se il file esiste
            if not os.path.exists(self.json_path):
                return {}

            # Ottiene il timestamp di ultima modifica del file
            file_modified_time = os.path.getmtime(self.json_path)
            
            # Se il file non è stato modificato dall'ultima lettura, usa la cache
            if file_modified_time <= self.last_read_time:
                return self.cached_values

            # Legge il file JSON
            with open(self.json_path, 'r') as f:
                content = f.read().strip()  # Rimuove spazi bianchi extra
                if not content:  # Se il file è vuoto
                    return {}
                try:
                    data = json.loads(content)
                except json.JSONDecodeError as e:
                    print(f"Errore nel parsing JSON: {e}")
                    print(f"Contenuto problematico: {content[:100]}...")  # Mostra i primi 100 caratteri
                    return self.cached_values  # Usa la cache in caso di errore
                
            # Aggiorna la cache e il timestamp
            if isinstance(data, dict):
                self.cached_values = data.get('controls', {})
                self.last_read_time = file_modified_time
            else:
                print(f"Formato JSON non valido. Atteso dizionario, ricevuto: {type(data)}")
                return self.cached_values

            return self.cached_values

        except Exception as e:
            print(f"Errore nella lettura dei valori: {e}")
            return self.cached_values  # Usa la cache in caso di errore

    def get_value(self, control_id):
        """Ottiene il valore specifico per un controllo"""
        values = self.read_values()
        try:
            value = values.get(f"{control_id}_value")
            # Converti le stringhe numeriche in numeri
            if isinstance(value, str):
                try:
                    if '.' in value:
                        return float(value)
                    else:
                        return int(value)
                except ValueError:
                    return value
            return value
        except Exception as e:
            print(f"Errore nel recupero del valore per {control_id}: {e}")
            return None

class MonitorInstance:
    _instance = None
    
    @classmethod
    def get_instance(cls):
        if cls._instance is None:
            cls._instance = ValueMonitor()
        return cls._instance

# Output: istanza del monitor
monitor = MonitorInstance.get_instance()
# ---------- end value_monitor ----------
merge_2 = Merge(Data1=panel_7, Data2=panel_9, Data3=panel_6, Data4=panel_8)
# temp file location
# make server
# and
# update html
temp_file_location = Python3Script()  # -> out
# ---------- temp_file_location: Python ----------
import tempfile
import os

temp_dir = tempfile.gettempdir()
print(f"Directory temporanea: {temp_dir}")

# Verifica la presenza dei file specifici
json_interface = os.path.join(temp_dir, 'gh_interface_data.json')
json_geometry = os.path.join(temp_dir, 'gh_geometry_data.json')
html_temp = os.path.join(temp_dir, 'gh_interface.html')

print(f"\nFile dell'interfaccia: {json_interface}")
print(f"Esiste: {os.path.exists(json_interface)}")

print(f"\nFile della geometria: {json_geometry}")
print(f"Esiste: {os.path.exists(json_geometry)}")
# ---------- end temp_file_location ----------
html_updater = Python3Script(server_instance=server_setup_2.server_instance, html_content=html_builder.page_html)  # -> success
# ---------- html_updater: Python ----------
"""Componente per l'aggiornamento dell'HTML del server"""
import tempfile
import json
import os

# Input:
#   html_content: stringa contenente l'HTML aggiornato
#   server_instance: istanza del server da html_builder.py

# Percorso del file temporaneo per l'HTML
HTML_CACHE_PATH = os.path.join(tempfile.gettempdir(), 'gh_html_cache.json')

def update_html(html_content, server_instance):
    """Aggiorna l'HTML del server senza riavviarlo"""
    if not server_instance or not html_content:
        return False
        
    try:
        # Salva l'HTML nel file temporaneo
        cache_data = {
            'html': html_content,
            'port': server_instance
        }
        
        with open(HTML_CACHE_PATH, 'w') as f:
            json.dump(cache_data, f)
            
        return True
        
    except Exception as e:
        print(f"Errore nell'aggiornamento dell'HTML: {e}")
        return False

# Output: True se l'aggiornamento è riuscito, False altrimenti
success = update_html(html_content, server_instance)
# ---------- end html_updater ----------
value_update = Python3Script(monitor=value_monitor, control_id=merge_2)  # -> value
# ---------- value_update: Python ----------
"""Componente per l'aggiornamento dei valori"""
import os
import tempfile
import Grasshopper as gh

# Input:
#   monitor: istanza del ValueMonitor
#   control_id: ID del controllo da monitorare
#   trigger: input trigger per forzare l'aggiornamento (non usato direttamente)

# Variabili globali per la cache
_last_modified_time = 0
_cached_value = None
_json_path = os.path.join(tempfile.gettempdir(), 'gh_interface_data.json')

def update_value(monitor, control_id):
    global _last_modified_time, _cached_value
    
    if monitor is None:
        return None
    
    try:
        # Verifica se il file esiste
        if not os.path.exists(_json_path):
            return None
            
        # Ottiene il timestamp di ultima modifica del file
        current_modified_time = os.path.getmtime(_json_path)
        
        # Se il file è stato modificato, aggiorna la cache e forza l'aggiornamento
        if current_modified_time > _last_modified_time:
            value = monitor.get_value(control_id)
            _last_modified_time = current_modified_time
            _cached_value = value
            
            # Forza l'aggiornamento del componente
            ghenv.Component.ExpireSolution(True)
            
            return value
            
        # Se il file non è stato modificato, usa la cache
        return _cached_value
        
    except Exception as e:
        print(f"Errore nell'aggiornamento del valore: {e}")
        return _cached_value  # In caso di errore, ritorna l'ultimo valore valido

# Output: valore aggiornato del controllo specificato
value = update_value(monitor, control_id)
# ---------- end value_update ----------
panel_18 = Panel(temp_file_location)
browser_opener = Python3Script(port=server_setup_2.port, openUI=Toggle(True))
# ---------- browser_opener: Python ----------
import webbrowser
import time

# Input:
#   openUI: bool - Trigger per aprire il browser (True/False)
#   port: int - Porta del server (default: 5000)

class BrowserOpener:
    _last_open_time = 0
    _min_interval = 5  # Intervallo minimo in secondi tra le aperture del browser
    
    @classmethod
    def open_interface(cls, port=5000):
        """
        Apre l'interfaccia nel browser solo se è passato abbastanza tempo dall'ultima apertura
        Args:
            port (int): Porta su cui è in esecuzione il server
        """
        current_time = time.time()
        
        # Controlla se è passato abbastanza tempo dall'ultima apertura
        if current_time - cls._last_open_time >= cls._min_interval:
            url = f'http://127.0.0.1:{port}'
            webbrowser.open(url)
            cls._last_open_time = current_time

# Utilizzo diretto nel componente
if openUI:  # trigger è l'input del componente
    BrowserOpener.open_interface(port)  # port è l'input del componente
# ---------- end browser_opener ----------
concatenate = Concatenate(FragmentA=merge_2, FragmentB=value_update, JoinSeparator=": ")
output_reading = Panel(concatenate)

# ---- group: 3d view next uptdates
mesh_colours = MeshColours(Colours=[RGB(140, 249, 0), RGB(0, 116, 0), RGB(36, 153, 44), RGB(137, 247, 0), RGB(168, 210, 64), RGB(184, 250, 60), RGB(53, 209, 64), RGB(165, 248, 168)])
deconstruct_mesh = DeconstructMesh(Mesh=mesh_colours)  # -> Vertices, Faces, Colours, Normals
geometry_handler = Python3Script(
    vertices=deconstruct_mesh.Vertices,
    faces=deconstruct_mesh.Faces,
    colors=deconstruct_mesh.Colours,
    normals=deconstruct_mesh.Normals)  # -> out, success; inputs vertices: list of Point3d, faces: list of String, colors: list of Color, normals: list of Vector3d
# ---------- geometry_handler: Python ----------
"""Componente per la gestione della geometria 3D"""
import json
import os
import tempfile
import time
import System.Drawing

# Input:
#   vertices: Lista di coordinate dei vertici dalla mesh decostruita
#   faces: Lista di facce dalla mesh decostruita
#   colors: Lista di colori (oggetti Color di Grasshopper)
#   normals: Lista di normali per vertice (opzionale)
#   trigger: Trigger per aggiornamento (opzionale)

JSON_PATH = os.path.join(tempfile.gettempdir(), 'gh_geometry_data.json')

def parse_face_indices(face):
    """Converte una faccia di Grasshopper in lista di indici"""
    try:
        # Se è un oggetto MeshFace di Grasshopper
        if hasattr(face, 'IsTriangle'):
            if face.IsTriangle:
                return [face.A, face.B, face.C]
            return [face.A, face.B, face.C, face.D]
        # Se la faccia è una stringa nel formato "Q(1, 0, 2, 3)"
        elif isinstance(face, str):
            # Estrai solo i numeri
            nums = ''.join(c for c in face if c.isdigit() or c == ',' or c == ' ')
            return [int(n.strip()) for n in nums.split(',')]
        # Se la faccia è già una lista o tupla di indici
        elif isinstance(face, (list, tuple)):
            return list(face)
        else:
            print(f"Tipo di faccia non riconosciuto: {type(face)}")
            return []
    except Exception as e:
        print(f"Errore nel parsing della faccia {face}: {e}")
        return []

def parse_color(color):
    """Converte un colore di Grasshopper in lista normalizzata"""
    try:
        if isinstance(color, System.Drawing.Color):
            return [color.R/255.0, color.G/255.0, color.B/255.0]
        elif isinstance(color, str):
            if ',' in color:
                # Se è una stringa "R,G,B"
                r, g, b = map(int, color.strip().split(','))
                return [r/255.0, g/255.0, b/255.0]
            else:
                print(f"Formato colore non riconosciuto: {color}")
                return [0.7, 0.7, 0.7]
        else:
            print(f"Tipo di colore non riconosciuto: {type(color)}")
            return [0.7, 0.7, 0.7]
    except Exception as e:
        print(f"Errore nella conversione del colore {color}: {e}")
        return [0.7, 0.7, 0.7]

def serialize_geometry(vertices, faces, colors, normals=None):
    """Serializza i dati della mesh decostruita per Three.js"""
    try:
        print("\n=== Debug Input ===")
        print(f"Numero vertici: {len(vertices)}")
        print(f"Numero facce: {len(faces)}")
        print(f"Numero colori: {len(colors)}")
        print(f"Tipo vertici: {type(vertices[0]) if vertices else 'None'}")
        print(f"Tipo facce: {type(faces[0]) if faces else 'None'}")
        print(f"Tipo colori: {type(colors[0]) if colors else 'None'}")
        
        # Converti vertici in lista di tuple e applica una trasformazione per Three.js
        vertices_list = [(v.X, v.Z, -v.Y) for v in vertices]  # Scambia Y e Z e inverte Y
        
        # Converti facce in liste di indici
        faces_list = [parse_face_indices(face) for face in faces]
        # Filtra le facce vuote
        faces_list = [f for f in faces_list if len(f) >= 3]
        
        # Converti colori in valori normalizzati
        colors_list = [parse_color(color) for color in colors]
        
        # Debug dei dati convertiti
        print("\n=== Dati Convertiti ===")
        print("Primi 3 vertici:")
        for i, v in enumerate(vertices_list[:3]):
            print(f"  v{i}: ({v[0]:.2f}, {v[1]:.2f}, {v[2]:.2f})")
        
        print("\nPrime 3 facce:")
        for i, f in enumerate(faces_list[:3]):
            print(f"  f{i}: {f}")
            if f:  # Solo se la faccia è valida
                print("    Vertici:", [vertices_list[idx] for idx in f])
        
        print("\nPrimi 3 colori:")
        for i, c in enumerate(colors_list[:3]):
            print(f"  c{i}: [{c[0]:.3f}, {c[1]:.3f}, {c[2]:.3f}]")
        
        # Prepara i dati per il JSON
        geometry_data = {
            "vertices": vertices_list,
            "faces": faces_list,
            "colors": colors_list,
            "timestamp": time.time()
        }
        
        # Aggiungi le normali se presenti
        if normals:
            normals_list = [(n.X, n.Y, n.Z) for n in normals]
            geometry_data["normals"] = normals_list
        
        # Salva su file
        with open(JSON_PATH, 'w') as f:
            json.dump(geometry_data, f)
        
        print("\n=== Dati Salvati con Successo ===")
        return True
        
    except Exception as e:
        print(f"Errore nella serializzazione della geometria: {e}")
        import traceback
        print(traceback.format_exc())
        return False

# Output
success = serialize_geometry(vertices, faces, colors, normals)
# ---------- end geometry_handler ----------
