# Grasshopper definition ghWebUI copia.gh (Grasshopper 1.0.8)
# plug-ins: RhinoCodePluginGH

trigger = Trigger(Interval=200, TimerInterval=200, Target=value_update)
server = Python3Script()  # -> out
# ---------- server: Python ----------
from flask import Flask, render_template_string, jsonify, request
import webbrowser
import threading
import socket
import time
import json
import os
import tempfile

# Usa la directory temporanea del sistema
JSON_PATH = os.path.join(tempfile.gettempdir(), 'gh_interface_data.json')

# Inizializza il file JSON se non esiste
def init_json_file():
    default_data = {
        "slider_value": 50,
        "shape": "circle",
        "last_update": time.time()
    }
    if not os.path.exists(JSON_PATH):
        with open(JSON_PATH, 'w') as f:
            json.dump(default_data, f)
    return default_data

# Modifica del contenuto HTML per utilizzare AJAX
html_content = """
<!DOCTYPE html>
<html>
<head>
    <title>Grasshopper Interface</title>
    <script src="https://cdnjs.cloudflare.com/ajax/libs/three.js/r128/three.min.js"></script>
    <script src="https://cdn.jsdelivr.net/npm/three@0.128.0/examples/js/controls/OrbitControls.js"></script>
    <style>
        body { 
            font-family: Arial, sans-serif; 
            margin: 0;
            display: flex;
            flex-direction: column;
            height: 100vh;
        }
        #controls { 
            padding: 20px;
            background-color: #f5f5f5;
        }
        .control { 
            margin: 10px 0;
            padding: 15px;
            background-color: white;
            border-radius: 8px;
            box-shadow: 0 2px 4px rgba(0,0,0,0.1);
        }
        #viewer {
            flex-grow: 1;
            width: 100%;
        }
    </style>
</head>
<body>
    <div id="controls">
        <div class="control">
            <label>Slider: <span id="slider-value">50</span></label>
            <input type="range" id="slider" min="0" max="100" value="50">
        </div>
        <div class="control">
            <label>Shape:</label>
            <select id="shape-select">
                <option value="circle">Circle</option>
                <option value="rectangle">Rectangle</option>
                <option value="polygon">Polygon</option>
            </select>
        </div>
    </div>
    <div id="viewer"></div>

    <script>
        // Inizializzazione Three.js
        const scene = new THREE.Scene();
        scene.background = new THREE.Color(0xf0f0f0);
        
        const viewer = document.getElementById('viewer');
        const camera = new THREE.PerspectiveCamera(75, viewer.clientWidth / viewer.clientHeight, 0.1, 1000);
        const renderer = new THREE.WebGLRenderer({ antialias: true });
        
        renderer.setSize(viewer.clientWidth, viewer.clientHeight);
        viewer.appendChild(renderer.domElement);
        
        // Luci
        const ambientLight = new THREE.AmbientLight(0x404040, 1);
        scene.add(ambientLight);
        
        const directionalLight = new THREE.DirectionalLight(0xffffff, 0.8);
        directionalLight.position.set(1, 1, 1);
        scene.add(directionalLight);
        
        const directionalLight2 = new THREE.DirectionalLight(0xffffff, 0.5);
        directionalLight2.position.set(-1, -1, -1);
        scene.add(directionalLight2);
        
        let currentMesh = null;
        let controls = null;

        // Gestione ridimensionamento
        window.addEventListener('resize', () => {
            const width = viewer.clientWidth;
            const height = viewer.clientHeight;
            camera.aspect = width / height;
            camera.updateProjectionMatrix();
            renderer.setSize(width, height);
        });

        function animate() {
            requestAnimationFrame(animate);
            if (controls) {
                controls.update(); // Aggiorna i controlli in ogni frame
            }
            renderer.render(scene, camera);
        }
        
        let lastGeometryUpdate = 0;
        let geometryUpdateInterval = 500; // Aggiorna la geometria ogni 500ms
        let isDragging = false;

        // Aggiungi gestione eventi di interazione
        function setupInteractionEvents() {
            renderer.domElement.addEventListener('mousedown', () => {
                isDragging = true;
            });
            
            renderer.domElement.addEventListener('mouseup', () => {
                isDragging = false;
            });
            
            renderer.domElement.addEventListener('mouseleave', () => {
                isDragging = false;
            });
        }

        // Modifica la funzione pollGeometry
        function pollGeometry() {
            // Non aggiornare se l'utente sta interagendo con la vista
            if (isDragging) return;
            
            // Controlla se è passato abbastanza tempo dall'ultimo aggiornamento
            const now = Date.now();
            if (now - lastGeometryUpdate < geometryUpdateInterval) return;
            
            fetch('/get_geometry')
                .then(response => response.json())
                .then(data => {
                    if (data.status !== 'error') {
                        updateGeometry(data);
                        lastGeometryUpdate = now;
                    }
                });
        }

        // Modifica l'intervallo di polling
        setInterval(pollGeometry, 100);

        function updateGeometry(geometryData) {
            // Se l'utente sta interagendo, ignora l'aggiornamento
            if (isDragging) return;

            // Salva la posizione e rotazione corrente della camera
            const currentCameraPosition = camera.position.clone();
            const currentCameraRotation = camera.rotation.clone();
            
            if (currentMesh) {
                scene.remove(currentMesh);
            }
            
            const geometry = new THREE.BufferGeometry();
            
            // Vertici
            const vertices = new Float32Array(geometryData.vertices.flat());
            geometry.setAttribute('position', new THREE.BufferAttribute(vertices, 3));
            
            // Facce - gestisci sia triangoli che quad
            const indices = [];
            geometryData.faces.forEach(face => {
                if (face.length === 4) {
                    indices.push(face[0], face[1], face[2]);
                    indices.push(face[2], face[3], face[0]);
                } else if (face.length === 3) {
                    indices.push(...face);
                }
            });
            geometry.setIndex(new THREE.BufferAttribute(new Uint16Array(indices), 1));
            
            // Colori
            const colors = new Float32Array(geometryData.colors.flat());
            geometry.setAttribute('color', new THREE.BufferAttribute(colors, 3));
            
            if (geometryData.normals) {
                const normals = new Float32Array(geometryData.normals.flat());
                geometry.setAttribute('normal', new THREE.BufferAttribute(normals, 3));
            } else {
                geometry.computeVertexNormals();
            }
            
            const material = new THREE.MeshPhongMaterial({
                vertexColors: true,
                side: THREE.DoubleSide,
                flatShading: false,
                shininess: 30
            });
            
            currentMesh = new THREE.Mesh(geometry, material);
            
            // Centra la geometria
            geometry.computeBoundingSphere();
            const center = geometry.boundingSphere.center;
            const radius = geometry.boundingSphere.radius;
            
            currentMesh.position.set(-center.x, -center.y, -center.z);
            
            // Configura i controlli OrbitControls solo la prima volta
            if (!controls) {
                controls = new THREE.OrbitControls(camera, renderer.domElement);
                controls.enableDamping = true;
                controls.dampingFactor = 0.05;
                controls.enableZoom = true;
                controls.enablePan = true;
                controls.enableRotate = true;
                controls.minDistance = radius * 0.5;
                controls.maxDistance = radius * 10;
                
                // Imposta la posizione iniziale della camera solo la prima volta
                camera.position.set(radius * 2, radius * 2, radius * 2);
                camera.lookAt(0, 0, 0);
                
                // Inizializza gli eventi di interazione
                setupInteractionEvents();
            } else {
                // Ripristina la posizione e rotazione della camera
                camera.position.copy(currentCameraPosition);
                camera.rotation.copy(currentCameraRotation);
            }
            
            scene.add(currentMesh);
        }

        // Avvia il loop di rendering
        animate();
        
        function updateServer(data) {
            fetch('/update', {
                method: 'POST',
                headers: {
                    'Content-Type': 'application/json',
                },
                body: JSON.stringify(data)
            });
        }

        function pollUpdates() {
            fetch('/get_values')
                .then(response => response.json())
                .then(data => {
                    document.getElementById('slider').value = data.slider_value;
                    document.getElementById('slider-value').textContent = data.slider_value;
                    document.getElementById('shape-select').value = data.shape;
                });
        }

        // Aggiorna i valori ogni 100ms
        setInterval(pollUpdates, 100);

        document.getElementById('slider').addEventListener('input', (e) => {
            const value = e.target.value;
            document.getElementById('slider-value').textContent = value;
            updateServer({
                slider_value: parseFloat(value),
                shape: document.getElementById('shape-select').value
            });
        });

        document.getElementById('shape-select').addEventListener('change', (e) => {
            updateServer({
                slider_value: parseFloat(document.getElementById('slider').value),
                shape: e.target.value
            });
        });
    </script>
</body>
</html>
"""

class WebInterface:
    _instance = None
    
    def __new__(cls):
        if cls._instance is None:
            cls._instance = super(WebInterface, cls).__new__(cls)
        return cls._instance
    
    def __init__(self):
        if not hasattr(self, 'initialized'):
            self.initialized = True
            self.app = Flask(__name__)
            self.server_thread = None
            self.port = self.find_free_port()
            self.setup_routes()
            init_json_file()
            
    def find_free_port(self):
        """Trova una porta libera partendo da 5000"""
        ports = range(5000, 5100)
        for port in ports:
            with socket.socket(socket.AF_INET, socket.SOCK_STREAM) as s:
                try:
                    s.bind(('127.0.0.1', port))
                    return port
                except socket.error:
                    continue
        raise RuntimeError("Nessuna porta disponibile trovata")
            
    def setup_routes(self):
        @self.app.route('/')
        def index():
            return render_template_string(html_content)
        
        @self.app.route('/update', methods=['POST'])
        def update():
            try:
                data = request.json
                data['last_update'] = time.time()
                with open(JSON_PATH, 'w') as f:
                    json.dump(data, f)
                return jsonify({"status": "success"})
            except Exception as e:
                return jsonify({"status": "error", "message": str(e)}), 500
        
        @self.app.route('/get_values')
        def get_values():
            try:
                with open(JSON_PATH, 'r') as f:
                    return jsonify(json.load(f))
            except Exception as e:
                return jsonify({"status": "error", "message": str(e)}), 500
        
        @self.app.route('/favicon.ico')
        def favicon():
            return '', 204  # Restituisce una risposta vuota con status code 204 (No Content)

        @self.app.route('/get_geometry')
        def get_geometry():
            try:
                geometry_path = os.path.join(tempfile.gettempdir(), 'gh_geometry_data.json')
                if os.path.exists(geometry_path):
                    with open(geometry_path, 'r') as f:
                        return jsonify(json.load(f))
                return jsonify({"status": "error", "message": "No geometry data"})
            except Exception as e:
                return jsonify({"status": "error", "message": str(e)})

    def stop_server(self):
        """Ferma il server se è in esecuzione"""
        if self.server_thread and self.server_thread.is_alive():
            print("Stopping existing server...")
            try:
                requests.get(f'http://127.0.0.1:{self.port}/shutdown')
            except:
                pass
            self.server_thread = None
            time.sleep(1)
            
    def start_server(self):
        self.stop_server()
        
        if not self.server_thread:
            self.server_thread = threading.Thread(target=self._run_server)
            self.server_thread.daemon = True
            self.server_thread.start()
            time.sleep(2)
            webbrowser.open(f'http://127.0.0.1:{self.port}')
            
    def _run_server(self):
        try:
            self.app.run(
                host='127.0.0.1',
                port=self.port, 
                debug=False,
                use_reloader=False
            )
        except Exception as e:
            print(f"Errore nell'avvio del server: {e}")

class ServerInstance:
    _instance = None
    _is_running = False
    
    @classmethod
    def get_instance(cls):
        if cls._instance is None:
            cls._instance = WebInterface()
        return cls._instance
    
    @classmethod
    def start_if_not_running(cls):
        if not cls._is_running:
            instance = cls.get_instance()
            instance.start_server()
            cls._is_running = True

# Output: nessuno necessario, il componente serve solo ad avviare il server
ServerInstance.start_if_not_running()
# ---------- end server ----------
value_monitor = Python3Script()  # -> monitor
# ---------- value_monitor: Python ----------
"""Componente per la gestione del monitoraggio dei valori"""
import json
import os
import tempfile
import time

# Input:
#   x: Trigger (opzionale, per forzare l'inizializzazione)

JSON_PATH = os.path.join(tempfile.gettempdir(), 'gh_interface_data.json')

class ValueMonitor:
    def __init__(self):
        self.last_check = 0
        self.last_values = (50, 'circle')
    
    def check_updates(self):
        try:
            if os.path.exists(JSON_PATH):
                mod_time = os.path.getmtime(JSON_PATH)
                if mod_time > self.last_check:
                    with open(JSON_PATH, 'r') as f:
                        data = json.load(f)
                    self.last_check = mod_time
                    self.last_values = (data['slider_value'], data['shape'])
                    return self.last_values
            return self.last_values
        except Exception as e:
            print(f"Errore nel monitoraggio: {e}")
            return self.last_values

class MonitorInstance:
    _instance = None
    
    @classmethod
    def get_instance(cls):
        if cls._instance is None:
            cls._instance = ValueMonitor()
        return cls._instance

# Crea l'istanza del monitor
monitor_instance = MonitorInstance.get_instance()

# Output per Grasshopper
monitor = monitor_instance  # Questo è l'output che verrà collegato al componente value_update
# ---------- end value_monitor ----------
value_update = Python3Script(monitor=value_monitor)  # -> a, b
# ---------- value_update: Python ----------
"""Componente per l'aggiornamento continuo dei valori"""

# Input:
#   t: Timer (collegare un componente Timer)
#   m: MonitorInstance (collegare l'output del componente Value Monitor)

def update_values(monitor):
    if monitor is None:
        return 50, 'circle'  # valori di default
    return monitor.check_updates()

# Output: valori aggiornati
a, b = update_values(monitor)  # Usa 'm' che è l'input dal componente Value Monitor
# ---------- end value_update ----------
panel = Panel([value_update.a, value_update.b])
panel_2 = Panel(server)
division = Division(A=value_update.a, B=2)
division_2 = Division(A=value_update.a, B=3)
negative = Negative(Value=division_2)
negative_2 = Negative(Value=division)
bounds = Bounds(Numbers=[division_2, negative])
bounds_2 = Bounds(Numbers=[division, negative_2])
polygon = Polygon(Plane=PlaneXY(0, 0, 0), Radius=value_update.a, Segments=6, FilletRadius=0)  # -> Polygon, Length
rectangle = Rectangle(Plane=PlaneXY(0, 0, 0), XSize=bounds_2, YSize=bounds, Radius=0)  # -> Rectangle, Length
circle = Circle(Plane=PlaneXY(0, 0, 0), Radius=value_update.a)
panel_3 = Panel("""circle
rectangle
polygon""")
member_index = MemberIndex(Set=panel_3, Member=value_update.b)  # -> Index, Count
stream_filter = StreamFilter(Gate=member_index.Index, Stream0=circle, Stream1=rectangle.Rectangle, Stream2=polygon.Polygon)
boundary_surfaces = BoundarySurfaces(Edges=stream_filter)
extrude = Extrude(Base=boundary_surfaces, Direction=Vector(0, 0, 100))
stream_filter_2 = StreamFilter(
    Gate=member_index.Index,
    Stream0=ColourSwatch(SwatchColor=RGB(219, 0, 175)),
    Stream1=ColourSwatch(SwatchColor=RGB(179, 219, 0)),
    Stream2=ColourSwatch(SwatchColor=RGB(0, 161, 219)))
mesh_colours = MeshColours(Mesh=extrude, Colours=stream_filter_2)
deconstruct_mesh = DeconstructMesh(Mesh=mesh_colours)  # -> Vertices, Faces, Colours, Normals
geometry_handler = Python3Script(
    vertices=deconstruct_mesh.Vertices,
    faces=deconstruct_mesh.Faces,
    colors=deconstruct_mesh.Colours,
    normals=deconstruct_mesh.Normals)  # -> out, success; inputs vertices: list of Point3d, faces: list of String, colors: list of Color, normals: list of Vector3d
# ---------- geometry_handler: Python ----------
"""Componente per la gestione della geometria 3D"""
import json
import os
import tempfile
import time
import System.Drawing

# Input:
#   vertices: Lista di coordinate dei vertici dalla mesh decostruita
#   faces: Lista di facce dalla mesh decostruita
#   colors: Lista di colori (oggetti Color di Grasshopper)
#   normals: Lista di normali per vertice (opzionale)
#   trigger: Trigger per aggiornamento (opzionale)

JSON_PATH = os.path.join(tempfile.gettempdir(), 'gh_geometry_data.json')

def parse_face_indices(face):
    """Converte una faccia di Grasshopper in lista di indici"""
    try:
        # Se è un oggetto MeshFace di Grasshopper
        if hasattr(face, 'IsTriangle'):
            if face.IsTriangle:
                return [face.A, face.B, face.C]
            return [face.A, face.B, face.C, face.D]
        # Se la faccia è una stringa nel formato "Q(1, 0, 2, 3)"
        elif isinstance(face, str):
            # Estrai solo i numeri
            nums = ''.join(c for c in face if c.isdigit() or c == ',' or c == ' ')
            return [int(n.strip()) for n in nums.split(',')]
        # Se la faccia è già una lista o tupla di indici
        elif isinstance(face, (list, tuple)):
            return list(face)
        else:
            print(f"Tipo di faccia non riconosciuto: {type(face)}")
            return []
    except Exception as e:
        print(f"Errore nel parsing della faccia {face}: {e}")
        return []

def parse_color(color):
    """Converte un colore di Grasshopper in lista normalizzata"""
    try:
        if isinstance(color, System.Drawing.Color):
            return [color.R/255.0, color.G/255.0, color.B/255.0]
        elif isinstance(color, str):
            if ',' in color:
                # Se è una stringa "R,G,B"
                r, g, b = map(int, color.strip().split(','))
                return [r/255.0, g/255.0, b/255.0]
            else:
                print(f"Formato colore non riconosciuto: {color}")
                return [0.7, 0.7, 0.7]
        else:
            print(f"Tipo di colore non riconosciuto: {type(color)}")
            return [0.7, 0.7, 0.7]
    except Exception as e:
        print(f"Errore nella conversione del colore {color}: {e}")
        return [0.7, 0.7, 0.7]

def serialize_geometry(vertices, faces, colors, normals=None):
    """Serializza i dati della mesh decostruita per Three.js"""
    try:
        print("\n=== Debug Input ===")
        print(f"Numero vertici: {len(vertices)}")
        print(f"Numero facce: {len(faces)}")
        print(f"Numero colori: {len(colors)}")
        print(f"Tipo vertici: {type(vertices[0]) if vertices else 'None'}")
        print(f"Tipo facce: {type(faces[0]) if faces else 'None'}")
        print(f"Tipo colori: {type(colors[0]) if colors else 'None'}")
        
        # Converti vertici in lista di tuple e applica una trasformazione per Three.js
        vertices_list = [(v.X, v.Z, -v.Y) for v in vertices]  # Scambia Y e Z e inverte Y
        
        # Converti facce in liste di indici
        faces_list = [parse_face_indices(face) for face in faces]
        # Filtra le facce vuote
        faces_list = [f for f in faces_list if len(f) >= 3]
        
        # Converti colori in valori normalizzati
        colors_list = [parse_color(color) for color in colors]
        
        # Debug dei dati convertiti
        print("\n=== Dati Convertiti ===")
        print("Primi 3 vertici:")
        for i, v in enumerate(vertices_list[:3]):
            print(f"  v{i}: ({v[0]:.2f}, {v[1]:.2f}, {v[2]:.2f})")
        
        print("\nPrime 3 facce:")
        for i, f in enumerate(faces_list[:3]):
            print(f"  f{i}: {f}")
            if f:  # Solo se la faccia è valida
                print("    Vertici:", [vertices_list[idx] for idx in f])
        
        print("\nPrimi 3 colori:")
        for i, c in enumerate(colors_list[:3]):
            print(f"  c{i}: [{c[0]:.3f}, {c[1]:.3f}, {c[2]:.3f}]")
        
        # Prepara i dati per il JSON
        geometry_data = {
            "vertices": vertices_list,
            "faces": faces_list,
            "colors": colors_list,
            "timestamp": time.time()
        }
        
        # Aggiungi le normali se presenti
        if normals:
            normals_list = [(n.X, n.Y, n.Z) for n in normals]
            geometry_data["normals"] = normals_list
        
        # Salva su file
        with open(JSON_PATH, 'w') as f:
            json.dump(geometry_data, f)
        
        print("\n=== Dati Salvati con Successo ===")
        return True
        
    except Exception as e:
        print(f"Errore nella serializzazione della geometria: {e}")
        import traceback
        print(traceback.format_exc())
        return False

# Output
success = serialize_geometry(vertices, faces, colors, normals)
# ---------- end geometry_handler ----------
custom_preview = CustomPreview(Geometry=extrude, Material=stream_filter_2)
