# Grasshopper definition ghWebUI.gh (Grasshopper 1.0.8)
# plug-ins: RhinoCodePluginGH

trigger = Trigger(Interval=200, TimerInterval=200, Target=value_update)
server = Python3Script()  # -> out
# ---------- server: Python ----------
from flask import Flask, render_template_string, jsonify, request
import webbrowser
import threading
import socket
import time
import json
import os
import tempfile

# Usa la directory temporanea del sistema
JSON_PATH = os.path.join(tempfile.gettempdir(), 'gh_interface_data.json')

# Inizializza il file JSON se non esiste
def init_json_file():
    default_data = {
        "slider_value": 50,
        "shape": "circle",
        "last_update": time.time()
    }
    if not os.path.exists(JSON_PATH):
        with open(JSON_PATH, 'w') as f:
            json.dump(default_data, f)
    return default_data

# Modifica del contenuto HTML per utilizzare AJAX
html_content = """
<!DOCTYPE html>
<html>
<head>
    <title>Grasshopper Interface</title>
    <style>
        body { 
            font-family: Arial, sans-serif; 
            padding: 20px;
            max-width: 800px;
            margin: 0 auto;
            background-color: #f5f5f5;
        }
        .control { 
            margin: 20px 0;
            padding: 20px;
            background-color: white;
            border-radius: 8px;
            box-shadow: 0 2px 4px rgba(0,0,0,0.1);
        }
        label {
            display: block;
            margin-bottom: 10px;
            font-weight: bold;
        }
        input[type="range"] {
            width: 100%;
            margin: 10px 0;
        }
        select {
            width: 100%;
            padding: 8px;
            border-radius: 4px;
            border: 1px solid #ddd;
        }
    </style>
</head>
<body>
    <div class="control">
        <label>Slider: <span id="slider-value">50</span></label>
        <input type="range" id="slider" min="0" max="100" value="50">
    </div>
    <div class="control">
        <label>Shape:</label>
        <select id="shape-select">
            <option value="circle">Circle</option>
            <option value="rectangle">Rectangle</option>
            <option value="polygon">Polygon</option>
        </select>
    </div>

    <script>
        function updateServer(data) {
            fetch('/update', {
                method: 'POST',
                headers: {
                    'Content-Type': 'application/json',
                },
                body: JSON.stringify(data)
            });
        }

        function pollUpdates() {
            fetch('/get_values')
                .then(response => response.json())
                .then(data => {
                    document.getElementById('slider').value = data.slider_value;
                    document.getElementById('slider-value').textContent = data.slider_value;
                    document.getElementById('shape-select').value = data.shape;
                });
        }

        // Aggiorna i valori ogni 100ms
        setInterval(pollUpdates, 100);

        document.getElementById('slider').addEventListener('input', (e) => {
            const value = e.target.value;
            document.getElementById('slider-value').textContent = value;
            updateServer({
                slider_value: parseFloat(value),
                shape: document.getElementById('shape-select').value
            });
        });

        document.getElementById('shape-select').addEventListener('change', (e) => {
            updateServer({
                slider_value: parseFloat(document.getElementById('slider').value),
                shape: e.target.value
            });
        });
    </script>
</body>
</html>
"""

class WebInterface:
    _instance = None
    
    def __new__(cls):
        if cls._instance is None:
            cls._instance = super(WebInterface, cls).__new__(cls)
        return cls._instance
    
    def __init__(self):
        if not hasattr(self, 'initialized'):
            self.initialized = True
            self.app = Flask(__name__)
            self.server_thread = None
            self.port = self.find_free_port()
            self.setup_routes()
            init_json_file()
            
    def find_free_port(self):
        """Trova una porta libera partendo da 5000"""
        ports = range(5000, 5100)
        for port in ports:
            with socket.socket(socket.AF_INET, socket.SOCK_STREAM) as s:
                try:
                    s.bind(('127.0.0.1', port))
                    return port
                except socket.error:
                    continue
        raise RuntimeError("Nessuna porta disponibile trovata")
            
    def setup_routes(self):
        @self.app.route('/')
        def index():
            return render_template_string(html_content)
        
        @self.app.route('/update', methods=['POST'])
        def update():
            try:
                data = request.json
                data['last_update'] = time.time()
                with open(JSON_PATH, 'w') as f:
                    json.dump(data, f)
                return jsonify({"status": "success"})
            except Exception as e:
                return jsonify({"status": "error", "message": str(e)}), 500
        
        @self.app.route('/get_values')
        def get_values():
            try:
                with open(JSON_PATH, 'r') as f:
                    return jsonify(json.load(f))
            except Exception as e:
                return jsonify({"status": "error", "message": str(e)}), 500
        
        @self.app.route('/favicon.ico')
        def favicon():
            return '', 204  # Restituisce una risposta vuota con status code 204 (No Content)

    def stop_server(self):
        """Ferma il server se è in esecuzione"""
        if self.server_thread and self.server_thread.is_alive():
            print("Stopping existing server...")
            try:
                requests.get(f'http://127.0.0.1:{self.port}/shutdown')
            except:
                pass
            self.server_thread = None
            time.sleep(1)
            
    def start_server(self):
        self.stop_server()
        
        if not self.server_thread:
            self.server_thread = threading.Thread(target=self._run_server)
            self.server_thread.daemon = True
            self.server_thread.start()
            time.sleep(2)
            webbrowser.open(f'http://127.0.0.1:{self.port}')
            
    def _run_server(self):
        try:
            self.app.run(
                host='127.0.0.1',
                port=self.port, 
                debug=False,
                use_reloader=False
            )
        except Exception as e:
            print(f"Errore nell'avvio del server: {e}")

class ServerInstance:
    _instance = None
    _is_running = False
    
    @classmethod
    def get_instance(cls):
        if cls._instance is None:
            cls._instance = WebInterface()
        return cls._instance
    
    @classmethod
    def start_if_not_running(cls):
        if not cls._is_running:
            instance = cls.get_instance()
            instance.start_server()
            cls._is_running = True

# Output: nessuno necessario, il componente serve solo ad avviare il server
ServerInstance.start_if_not_running()
# ---------- end server ----------
value_monitor = Python3Script()  # -> monitor
# ---------- value_monitor: Python ----------
"""Componente per la gestione del monitoraggio dei valori"""
import json
import os
import tempfile
import time

# Input:
#   x: Trigger (opzionale, per forzare l'inizializzazione)

JSON_PATH = os.path.join(tempfile.gettempdir(), 'gh_interface_data.json')

class ValueMonitor:
    def __init__(self):
        self.last_check = 0
        self.last_values = (50, 'circle')
    
    def check_updates(self):
        try:
            if os.path.exists(JSON_PATH):
                mod_time = os.path.getmtime(JSON_PATH)
                if mod_time > self.last_check:
                    with open(JSON_PATH, 'r') as f:
                        data = json.load(f)
                    self.last_check = mod_time
                    self.last_values = (data['slider_value'], data['shape'])
                    return self.last_values
            return self.last_values
        except Exception as e:
            print(f"Errore nel monitoraggio: {e}")
            return self.last_values

class MonitorInstance:
    _instance = None
    
    @classmethod
    def get_instance(cls):
        if cls._instance is None:
            cls._instance = ValueMonitor()
        return cls._instance

# Crea l'istanza del monitor
monitor_instance = MonitorInstance.get_instance()

# Output per Grasshopper
monitor = monitor_instance  # Questo è l'output che verrà collegato al componente value_update
# ---------- end value_monitor ----------
value_update = Python3Script(monitor=value_monitor)  # -> a, b
# ---------- value_update: Python ----------
"""Componente per l'aggiornamento continuo dei valori"""

# Input:
#   t: Timer (collegare un componente Timer)
#   m: MonitorInstance (collegare l'output del componente Value Monitor)

def update_values(monitor):
    if monitor is None:
        return 50, 'circle'  # valori di default
    return monitor.check_updates()

# Output: valori aggiornati
a, b = update_values(monitor)  # Usa 'm' che è l'input dal componente Value Monitor
# ---------- end value_update ----------
panel = Panel([value_update.a, value_update.b])
panel_2 = Panel(server)
division = Division(A=value_update.a, B=3)
negative = Negative(Value=division)
division_2 = Division(A=value_update.a, B=2)
negative_2 = Negative(Value=division_2)
bounds = Bounds(Numbers=[division, negative])
bounds_2 = Bounds(Numbers=[division_2, negative_2])
polygon = Polygon(Plane=PlaneXY(0, 0, 0), Radius=value_update.a, Segments=6, FilletRadius=0)  # -> Polygon, Length
rectangle = Rectangle(Plane=PlaneXY(0, 0, 0), XSize=bounds_2, YSize=bounds, Radius=0)  # -> Rectangle, Length
circle = Circle(Plane=PlaneXY(0, 0, 0), Radius=value_update.a)
panel_3 = Panel("""circle
rectangle
polygon""")
member_index = MemberIndex(Set=panel_3, Member=value_update.b)  # -> Index, Count
stream_filter = StreamFilter(Gate=member_index.Index, Stream0=circle, Stream1=rectangle.Rectangle, Stream2=polygon.Polygon)
boundary_surfaces = BoundarySurfaces(Edges=stream_filter)
extrude = Extrude(Base=boundary_surfaces, Direction=Vector(0, 0, 100))
mesh_brep = MeshBrep(
    Brep=extrude,
    Settings={GridMaxCount=0, GridMinCount=16, JaggedSeams=False, MaxEdgeLength=0, MinEdgeLength=0.0001, MinTolerance=0, Refine=True, RefineAngle=0, RelativeTolerance=0.65, SimplePlanes=True, Tolerance=0})
stream_filter_2 = StreamFilter(
    Gate=member_index.Index,
    Stream0=ColourSwatch(SwatchColor=RGB(219, 0, 175)),
    Stream1=ColourSwatch(SwatchColor=RGB(179, 219, 0)),
    Stream2=ColourSwatch(SwatchColor=RGB(0, 161, 219)))
custom_preview = CustomPreview(Geometry=mesh_brep, Material=stream_filter_2)
